# Grasshopper definition parametric stacking.gh (Grasshopper 1.0.7)
# plug-ins: Fologram for Grasshopper, Pufferfish

sync_parameters = SyncParameters(num_augmented_triggers=13)

# ----
# INPUTS
random_threshold = Slider(30, range=0..100)
random_intensity = Slider(0, range=0..1)
min_rotation = Slider(-15, range=-90..90)
max_rotation = Slider(15, range=-90..90)
num_layers = Slider(26, range=1..100)
threshold = Slider(60, range=0..100)
gap = Slider(1, range=0..10)
width = Panel("3.625")
height = Panel("2.25")
length = Panel("7.625")
attractor_points = Geometry([<point referenced from the Rhino model> x2])
input_curve = Geometry(<curve referenced from the Rhino model>)

# ---- group: create stacked bricks
addition = Addition(A=length, B=gap)
divlength = DivideLength(Curve=input_curve, Length=expr("x/2", addition))  # -> Points, Tangents, Parameters
pframe = PerpFrame(Curve=input_curve, Parameter=divlength.Parameters)
length_2 = Number(length)
width_2 = Number(width)
height_2 = Number(height)
rectangle = Rectangle(Plane=pframe, XSize=width_2, YSize=height_2, Radius=0)  # -> Rectangle, Length
offsrf = OffsetSurface(Surface=rectangle.Rectangle, Distance=length_2, BothSides=0, CreateSolid=True)  # -> flatten(Offset)
Z = UnitZ(Factor=height_2)
dispatch = Dispatch(List=offsrf, DispatchPattern=[True, False])  # -> ListA, ListB
move = Move(Geometry=dispatch.ListB, Motion=Z)  # -> Geometry, Transform
group = Group(Objects=flatten(dispatch.ListA))
group_2 = Group(Objects=flatten(move.Geometry))
merge = Merge(Data1=group, Data2=group_2)
group_3 = Group(Objects=merge)
arrlinear = LinearArray(Geometry=group_3, Direction=expr("x*2", Z), Count=expr("x/2", num_layers))  # -> flatten(Geometry), Transform
ungroup = Ungroup(Group=arrlinear.Geometry)  # -> flatten(Objects)
ungroup_2 = Ungroup(Group=ungroup)  # -> simplify(Objects)
stacked_bricks = Geometry(flatten(ungroup_2))
bricks_as_tree = Geometry(ungroup_2)

# ---- group: cull bricks with volumes / set volumes here
intersection_volumes = Geometry(<brep referenced from the Rhino model>)

# ---- group: cull bricks with volumes
list = ValueList({"No Cull": 0, "Cull": 1}, selected="No Cull")
python = GhPythonScript(volumes=intersection_volumes, input=flatten(stacked_bricks))  # -> out, culled; inputs volumes: list, input: list
# ---------- python: Python ----------
__author__ = "saksh"
__version__ = "2024.02.15"

import rhinoscriptsyntax as rs
import Rhino.Geometry as rg

def cull_bricks_wrapper(bricks):
    # iterate through intersection volumes
    for volume in volumes:
        volume = rs.coercebrep(volume)
        bricks = cull_bricks(volume, bricks)
    return bricks

def cull_bricks(volume, bricks):
    culled = []
    for brick in bricks:
        centroid = rg.VolumeMassProperties.Compute(brick).Centroid
        intersect = volume.IsPointInside(centroid, 0.001, False)
        if not intersect:
            culled.append(brick)
    return culled

# reference the breps in input bricks list
bricks = []
for brick in input:
    bricks.append(rs.coercebrep(brick))

culled = cull_bricks_wrapper(bricks)
# ---------- end python ----------

# ---- group: rotate bricks
filter = StreamFilter(Gate=list, Stream0=stacked_bricks, Stream1=python.culled)
rot_domain = ConstructDomain(DomainStart=min_rotation, DomainEnd=max_rotation)
points = Geometry(attractor_points)
python_2 = GhPythonScript(
    bricks=filter,
    index=Slider(0, range=0..7),
    points=points,
    rotation_domain=rot_domain,
    threshold=threshold,
    rand_threshold=random_threshold,
    rand_intensity=random_intensity)  # -> out, rotated, pts; inputs bricks: list, points: list
# ---------- python_2: Python ----------
__author__ = "sakshi"
__version__ = "2024.02.14"

import rhinoscriptsyntax as rs
import Rhino.Geometry as rg
import math
import random

def main():
    # visualize rotation points for collision purposes
    rotated = []
    for brick in bricks:
        # get rotation point
        newbrick = rs.coercebrep(brick)
        rotation_pt = get_rotation_pt(newbrick)
        if rotation_pt == None:
            continue
        pts.append(rotation_pt)
        # check if near attractor points + rotate
        angle = 0
        for point in points:
            dist = calc_dist(rotation_pt, point, threshold)
            angle += remap(dist)
            # apply random rotation
            rand_dist = calc_dist(rotation_pt, point, rand_threshold)
            angle += calc_random(rand_dist)
            rand_rotation = calc_random(rand_dist)
        newbrick.Rotate(angle, rg.Vector3d.ZAxis, rotation_pt)
        rotated.append(newbrick)
    return rotated

# find the point to rotate around
# NOTE: CHANGE INDEX VALUE TO GET CORRECT POINT
def get_rotation_pt(brick):
    vertices = brick.DuplicateVertices()
    if not vertices:
        return
    return vertices[index]

# calculates the distance between a centroid and point attractor
# returns the distance if within threshold t, otherwise -1
def calc_dist(centroid, point, t):
    dist = rs.Distance(centroid, point)
    if (dist > t):
        return -1
    else:
        return dist

# remaps distance to a user specified rotation domain
# output in radians
def remap(dist):
    if (dist == -1):
        return 0
    min, max = rotation_domain.Min, rotation_domain.Max
    remap = min + (dist * (max - min)) / threshold
    return math.radians(remap)

# generate a random rotation value based on user specified intensity
# output in radians
def calc_random(dist):
    if (dist == -1):
        return 0
    min = 0
    max = 180 * rand_intensity
    return math.radians(random.uniform(min, max))

# run script
pts = []
rotated = main()
# ---------- end python_2 ----------
rotation_points = Geometry(python_2.pts)
rotated_bricks = Geometry(python_2.rotated)

# ---- group: outputs
unflatten = UnflattenTree(Tree=rotated_bricks, Guide=bricks_as_tree)
smesh = SimpleMesh(Brep=unflatten)
colmm = CollisionManyMany(Colliders=smesh)  # -> Collision, Indices
ma = MassAddition(Input=colmm.Collision)  # -> flatten(Result), PartialResults
ma_2 = MassAddition(Input=ma.Result)  # -> Result, PartialResults
lng = ListLength(List=stacked_bricks)

# ---- group: select courses
course_num = Slider(0, range=0..100)
course = TreeBranch(Tree=unflatten, Path=course_num, MaintainPaths=True)

# ----
# OUTPUTS
collision_count = Panel(ma_2.Result)
num_bricks = Panel(lng)
rotated_bricks_2 = Geometry(rotated_bricks)
